# Grasshopper definition MIDI_Listener_Example.gh (Grasshopper 1.0.8)
# plug-ins: MIDI Listener

# This example is based on the template I'm using with my Novation Launch Control XL MK3 (here) and Akai LPD8 (below).
# 
# The component Run by default listening all channels of device 0. If midi events are detected, the component will update and wait a Cooldown time of 100 milliseconds by default, or based on output Rate. The component can be stopped sending a False to the ⏻ input. The output Rate time could be adjusted but be careful working with large definitions.
# 
# ID? list all the available devices. Use it as a reference to set ID.
# 
# CC and Vel collect the last value received from the Continuous Control and the velocities at Note ON. If a note off message is received, Vel is set to 0 for the corresponding note.
# The cooresponding CC and Note numbers are implicitly represented by the position in the list. This solution allows to track the current state of a MIDI controller.
number_slider = Slider(0, range=0..16)
panel = Panel("Akai LPD8")
midi_in = MIDIListener(DeviceIndex=Slider(0, range=0..3), Channel=number_slider, ListenStop=Toggle(True), OutputRateMs="10")  # -> AvailableMIDIInputsIDs, CC, NoteVelocity
midi_in_2 = MIDIListener(DeviceIndex=Slider(2, range=0..3), Channel=Slider(0, range=0..16), ListenStop=Toggle(True), OutputRateMs="10")  # -> AvailableMIDIInputsIDs, CC, NoteVelocity
panel_2 = Panel(midi_in.AvailableMIDIInputsIDs)
panel_3 = Panel(midi_in_2.AvailableMIDIInputsIDs)
panel_4 = Panel(midi_in.CC)
panel_5 = Panel("""1
2
3
4
5
6
7
8""")
panel_6 = Panel("""1
2
3
4
5
6
7
8""")
item = ListItem(List=midi_in_2.CC, Index=panel_5, Wrap=True)  # -> flatten(Item)
item_2 = ListItem(List=midi_in_2.NoteVelocity, Index=panel_6, Wrap=True)  # -> flatten(Item)
panel_7 = Panel(midi_in.NoteVelocity)
bang = ExplodeTree(Data=simplify(graft(item)))  # -> Branch0, Branch1, Branch2, Branch3, Branch4, Branch5, Branch6, Branch7
bang_2 = ExplodeTree(Data=simplify(graft(item_2)))  # -> Branch0, Branch1, Branch2, Branch3, Branch4, Branch5, Branch6, Branch7
panel_8 = Panel("""16
17
18
19
20
21
22
23""")
panel_9 = Panel("""24
25
26
27
28
29
30
31""")
panel_10 = Panel("""8
9
10
11
12
13
14
15""")
panel_11 = Panel("""0
32""")
panel_12 = Panel("""2
34""")
panel_13 = Panel("""1
33""")
panel_14 = Panel("""64
65
66
67
68
69
70
71""")
panel_15 = Panel("""72
73
74
75
76
77
78
79""")
panel_16 = Panel("""3
35""")
panel_17 = Panel("""4
36""")
panel_18 = Panel("""5
37""")
panel_19 = Panel("""6
38""")
panel_20 = Panel("""7
39""")
panel_21 = Panel(bang.Branch0)
panel_22 = Panel(bang.Branch2)
panel_23 = Panel(bang.Branch4)
panel_24 = Panel(bang.Branch6)
panel_25 = Panel(bang_2.Branch0)
panel_26 = Panel(bang_2.Branch2)
panel_27 = Panel(bang_2.Branch4)
panel_28 = Panel(bang_2.Branch6)
item_3 = ListItem(List=midi_in.CC, Index=panel_10, Wrap=True)  # -> flatten(Item)
item_4 = ListItem(List=midi_in.CC, Index=panel_8, Wrap=True)  # -> flatten(Item)
item_5 = ListItem(List=midi_in.CC, Index=panel_9, Wrap=True)  # -> flatten(Item)
item_6 = ListItem(List=midi_in.CC, Index=panel_14, Wrap=True)  # -> flatten(Item)
item_7 = ListItem(List=midi_in.CC, Index=panel_15, Wrap=True)  # -> flatten(Item)
item_8 = ListItem(List=midi_in.CC, Index=panel_11, Wrap=True)
item_9 = ListItem(List=midi_in.CC, Index=panel_12, Wrap=True)
item_10 = ListItem(List=midi_in.CC, Index=panel_13, Wrap=True)
item_11 = ListItem(List=midi_in.CC, Index=panel_16, Wrap=True)
item_12 = ListItem(List=midi_in.CC, Index=panel_17, Wrap=True)
item_13 = ListItem(List=midi_in.CC, Index=panel_19, Wrap=True)
item_14 = ListItem(List=midi_in.CC, Index=panel_18, Wrap=True)
panel_29 = Panel("""128
1""")
item_15 = ListItem(List=midi_in.CC, Index=panel_20, Wrap=True)
panel_30 = Panel("""128
1""")
panel_31 = Panel("""128
1""")
panel_32 = Panel("""128
1""")
panel_33 = Panel("""128
1""")
panel_34 = Panel(bang.Branch1)
panel_35 = Panel(bang.Branch3)
panel_36 = Panel(bang.Branch5)
panel_37 = Panel(bang.Branch7)
panel_38 = Panel(bang_2.Branch3)
panel_39 = Panel(bang_2.Branch5)
panel_40 = Panel("""128
1""")
panel_41 = Panel(bang_2.Branch1)
panel_42 = Panel(bang_2.Branch7)
panel_43 = Panel("""128
1""")
panel_44 = Panel("""128
1""")
bang_3 = ExplodeTree(Data=simplify(graft(item_6)))  # -> Branch0, Branch1, Branch2, Branch3, Branch4, Branch5, Branch6, Branch7
bang_4 = ExplodeTree(Data=simplify(graft(item_7)))  # -> Branch0, Branch1, Branch2, Branch3, Branch4, Branch5, Branch6, Branch7
bang_5 = ExplodeTree(Data=simplify(graft(item_3)))  # -> Branch0, Branch1, Branch2, Branch3, Branch4, Branch5, Branch6, Branch7
bang_6 = ExplodeTree(Data=simplify(graft(item_4)))  # -> Branch0, Branch1, Branch2, Branch3, Branch4, Branch5, Branch6, Branch7
bang_7 = ExplodeTree(Data=simplify(graft(item_5)))  # -> Branch0, Branch1, Branch2, Branch3, Branch4, Branch5, Branch6, Branch7
multiplication = Multiplication(A=item_8, B=panel_29)
multiplication_2 = Multiplication(A=item_9, B=panel_30)
multiplication_3 = Multiplication(A=item_10, B=panel_31)
multiplication_4 = Multiplication(A=item_11, B=panel_32)
multiplication_5 = Multiplication(A=item_12, B=panel_33)
larger = LargerThan(FirstNumber=panel_25, SecondNumber=0)  # -> LargerThan, OrEqualTo
multiplication_6 = Multiplication(A=item_13, B=panel_40)
multiplication_7 = Multiplication(A=item_14, B=panel_43)
multiplication_8 = Multiplication(A=item_15, B=panel_44)
ma = MassAddition(Input=multiplication)  # -> flatten(Result), PartialResults
ma_2 = MassAddition(Input=multiplication_2)  # -> flatten(Result), PartialResults
ma_3 = MassAddition(Input=multiplication_3)  # -> flatten(Result), PartialResults
ma_4 = MassAddition(Input=multiplication_4)  # -> flatten(Result), PartialResults
ma_5 = MassAddition(Input=multiplication_5)  # -> flatten(Result), PartialResults
ma_6 = MassAddition(Input=multiplication_6)  # -> flatten(Result), PartialResults
ma_7 = MassAddition(Input=multiplication_7)  # -> flatten(Result), PartialResults
ma_8 = MassAddition(Input=multiplication_8)  # -> flatten(Result), PartialResults
panel_45 = Panel(larger.LargerThan)
# The Launch Control XL MK3 faders are double precision ones. The output of two channels must be combines to have a 14bit signal. This is not needed with regular midi devices.
# 
# Could be useful to combine two pots, or maybe a pot and a fader to have a raw control and a finetune one.
panel_46 = Panel(ma_3.Result)
panel_47 = Panel(ma_4.Result)
panel_48 = Panel(ma_7.Result)
panel_49 = Panel(ma_8.Result)
panel_50 = Panel(ma.Result)
panel_51 = Panel(ma_2.Result)
panel_52 = Panel(ma_5.Result)
panel_53 = Panel(ma_6.Result)
panel_54 = Panel(bang_5.Branch0)
panel_55 = Panel(bang_5.Branch4)
panel_56 = Panel(bang_3.Branch2)
panel_57 = Panel(bang_3.Branch4)
panel_58 = Panel(bang_3.Branch6)
panel_59 = Panel(bang_4.Branch0)
panel_60 = Panel(bang_4.Branch6)
panel_61 = Panel(bang_5.Branch2)
panel_62 = Panel(bang_5.Branch6)
panel_63 = Panel(bang_6.Branch0)
panel_64 = Panel(bang_6.Branch4)
panel_65 = Panel(bang_7.Branch0)
panel_66 = Panel(bang_7.Branch4)
panel_67 = Panel(bang_3.Branch0)
panel_68 = Panel(bang_4.Branch2)
panel_69 = Panel(bang_4.Branch4)
panel_70 = Panel(bang_6.Branch2)
panel_71 = Panel(bang_6.Branch6)
panel_72 = Panel(bang_7.Branch2)
panel_73 = Panel(bang_7.Branch6)
panel_74 = Panel(bang_5.Branch3)
panel_75 = Panel(bang_5.Branch5)
panel_76 = Panel(bang_5.Branch7)
panel_77 = Panel(bang_5.Branch1)
panel_78 = Panel(bang_6.Branch3)
panel_79 = Panel(bang_6.Branch5)
panel_80 = Panel(bang_6.Branch7)
panel_81 = Panel(bang_7.Branch3)
panel_82 = Panel(bang_7.Branch5)
panel_83 = Panel(bang_7.Branch7)
panel_84 = Panel(bang_3.Branch3)
panel_85 = Panel(bang_3.Branch7)
panel_86 = Panel(bang_4.Branch5)
panel_87 = Panel(bang_6.Branch1)
panel_88 = Panel(bang_7.Branch1)
panel_89 = Panel(bang_3.Branch1)
panel_90 = Panel(bang_3.Branch5)
panel_91 = Panel(bang_4.Branch1)
panel_92 = Panel(bang_4.Branch3)
panel_93 = Panel(bang_4.Branch7)
merge = Merge(
    Data1=ma.Result,
    Data2=ma_3.Result,
    Data3=ma_2.Result,
    Data4=ma_4.Result,
    Data5=ma_5.Result,
    Data6=ma_7.Result,
    Data7=ma_6.Result,
    Data8=ma_8.Result)
bang_8 = ExplodeTree(Data=simplify(graft(merge)))  # -> Branch0, Branch1, Branch2, Branch3, Branch4, Branch5, Branch6, Branch7
remap = RemapNumbers(Value=bang_5.Branch0, Source="0 to 127", Target=Domain(0, 1))  # -> Mapped, Clipped
panel_94 = Panel(bang_8.Branch0)
panel_95 = Panel(bang_8.Branch2)
panel_96 = Panel(bang_8.Branch4)
panel_97 = Panel(bang_8.Branch6)
panel_98 = Panel(remap.Mapped)
panel_99 = Panel(bang_8.Branch1)
panel_100 = Panel(bang_8.Branch3)
panel_101 = Panel(bang_8.Branch5)
panel_102 = Panel(bang_8.Branch7)
remap_2 = RemapNumbers(Value=bang_8.Branch0, Source="0 to 16383", Target=Domain(0, 1))  # -> Mapped, Clipped
panel_103 = Panel(remap_2.Mapped)
